vi "Main.gviweb"   [LabVIEW NXG 2.1.0]
panel controls:
  "Tab": i32
  "Skyline.Examples.Oven.Outside.Temp-slider-control": f64
  "Skyline.Examples.Oven.Inside.Temp-slider-control": f64
  "Skyline.Examples.DataServices.string_control": string
  "Skyline.Examples.DataServices.numeric_slider-control": f64
  "Skyline.Examples.DataServices.int_control": bool
  "deque message": bool
  "Publish": bool
  "Numeric": f64
  "Switch": bool
  "Enum": T1 = "State One"
  "String": string
  "connect": bool
  "generate-fault": bool
  "clear-fault": bool
panel indicators:
  "debugging tips": string
  "Queued Messages Remaining": f64
  "Numeric Indicator": f64
  "Boolean Indicator": bool
  "String Indicator": string
  "List Box": i32
  "URL Image": string
  "Data Grid": T2[]
  "errror out": error
types:
  T1 = enum{"State One", "State Two ", "State Three", "State Four", "State Five"}
  T2 = cluster{"Battery": string, "Ramp": f64, "Load": f64, "Trend": string, "Status": string}
  "Message Cluster.gtype" = cluster{"Numeric": f64, "Switch": bool, "State": u16, "String": string}
uses:
  NI::G Core::Error::Clear Error Cluster.gvi
  subvis::Initialize.gvi
  subvis::Read Example Tags.gvi
  subvis::FormatGrid.gvi
  subvis::Write Example Tags.gvi
  subvis::Update Remaining Queue Indicator.gvi
  subvis::Deque Message.gvi
  subvis::Publish Message.gvi
  subvis::Build Error Message.gvi
  subvis::Determine Next State.gvi
diagram:
  w1 = "initialize"  # State
  # This diagram is idenitcal to Main.gvi
  s1 = uninitialised  # shift register
  s2 = uninitialised  # shift register
  s3 = w1  # shift register
  s4 = uninitialised  # shift register
  while {
    Wait(time to wait=250)
    case (s3) {
      frame "initialize", Default {
        w6 = ["customizingwebvis.battery.ramp.1", "customizingwebvis.battery.ramp.2", "customizingwebvis.battery.ramp.3", "customizingwebvis.battery.load.3", "customizingwebvis.battery.load.3", "customizingwebvis.battery.load.3"]
        # Clear errors and try to connect to the Skyline server.
        call "Clear Error Cluster.gvi"(error in=s1) -> (error out=w7)
        sequence {
          frame 0 {
            $"debugging tips" <- ""
          }
        }
        call "Initialize.gvi"(server url="https://api.systemlinkcloud.com", api key="oqQI651Yi2qoRft_ybcuYUX_rd5i1AP7vDmQTFKpPH", tag paths=w6, AuthPicker=1, error in=w7) -> (SystemLink Connection=w4, error out=w3)
        # Read tags first to get their latest value
        w2 = "read-tags"
        w5 = default
      }
      frame "read-tags" {
        w8 = "read-tags"  # State
        # Updates both controls and indicators to ensure that tag values aren't overwritten with stale controls values after switching tabs
        call "Read Example Tags.gvi"(SystemLink Connection=s2, error in=s1) -> (SystemLink Connection out=w4, ramp=w9, load=w10, error out=w11)
        call "FormatGrid.gvi"(ramp=w9, load=w10, Error In=w11) -> (Data Grid=w12, Error Out=w3)
        $"Data Grid" <- w12
        w2 = w8
        w5 = default
      }
      frame "write-tags" {
        call "Write Example Tags.gvi"(SystemLink Connection=s2, example.skyline-data-services.int_control=$"Skyline.Examples.DataServices.int_control", example.skyline-data-services.numeric_slider-control=$"Skyline.Examples.DataServices.numeric_slider-control", example.skyline-data-services.string_control=$"Skyline.Examples.DataServices.string_control", Skyline.Examples.Oven.Inside.Temp-slider-control=$"Skyline.Examples.Oven.Inside.Temp-slider-control", Skyline.Examples.Oven.Outside.Temp-slider-control=$"Skyline.Examples.Oven.Outside.Temp-slider-control", error in=s1) -> (SystemLink Connection out=w4, errror out=w3)
        w2 = $Tab
        w5 = default
      }
      frame "read-message" {
        call "Update Remaining Queue Indicator.gvi"(SystemLink Connection=s2, queue size=s4, error in=s1) -> (SystemLink Connection out=w13, updated queue sie=w5, Queued Messages Remaining=w14, error out=w15)
        call "Deque Message.gvi"(SystemLink Connection=w13, deque message=$"deque message", error in=w15) -> (SystemLink Connection out=w4, Message Out=w16, error out=w3)
        Property Node(instance in=w16) -> ("Numeric"=w17, "Switch"=w18, "State"=w19, "String"=w20)
        $"Numeric Indicator" <- w17
        $"Boolean Indicator" <- w18
        $"List Box" <- w19
        $"String Indicator" <- w20
        $"Queued Messages Remaining" <- w14
        w2 = $Tab
      }
      frame "write-message" {
        # Only publish when the user clicks the button. Otherwise a new message will be enqueued every iteration this state is active
        Property Node(instance in="Message Cluster.gtype" {all zero or empty}, "Numeric"=$Numeric, "Switch"=$Switch, "State"=$Enum, "String"=$String) -> (instance out=w21)
        call "Publish Message.gvi"(SystemLink Connection=s2, publish=$Publish, Message Cluster=w21, error=s1) -> (SystemLink Connection out=w4, error out=w3)
        w2 = $Tab
        w5 = default
      }
      frame "error-no-skyline" {
        # If there is an error update the user by displaying troubleshooting tips
        call "Build Error Message.gvi"(error in=s1) -> (error out=w3, error state=w22)
        $"debugging tips" <- w22
        w2 = s3
        w4 = s2
        w5 = default
      }
    }
    call "Determine Next State.gvi"(state in=w2, connect=$connect, error in=w3) -> (state out=w23, errror out=w24)
    $"errror out" <- w24
    # init queue size
    next s1 = w24
    next s2 = w4
    next s3 = w23
    next s4 = w5
    stop if FALSE
  }
