vi "Determine Next State.gvi"   [LabVIEW NXG 2.1.0]
inputs:
  "state in": "State.gtype" = "error-no-skyline"
  "error in": error
  "generate-fault": bool
  "clear-fault": bool
outputs:
  "errror out": error
  "state out": "State.gtype"
types:
  "State.gtype" = enum{"read-tags", "write-tags", "read-message", "write-message", "error-no-skyline", "initialize", "generate-fault", "clear-fault"}
diagram:
  w1 = "generate-fault"  # State
  w2 = "error-no-skyline"  # State
  Select(s=$"error in", t=w2, f=$"state in") -> w3
  Select(s=$"generate-fault", t=w1, f=w3) -> w4
  Select(s=$"clear-fault", t="clear-fault", f=w4) -> w5
  $"state out" <- w5
  # Go to the state determined by the tab control.
  #
  # If there is an error go to the error state.
  #
  # If the user clicks Connect then go to the Initialize state regardless if there is an error.
  $"errror out" <- $"error in"
