vi "FormatGrid.gvi"   [LabVIEW NXG 2.1.0]
inputs:
  "ramp": f64[]
  "Error In": error
  "load": f64[]
outputs:
  "Output": T1[]
  "Error Out": error
types:
  T1 = cluster{"Battery": string, "Ramp": f64, "Trend": string, "Load": f64, "Status": string}
diagram:
  for {
    w1 = each element of $ramp
    w2 = each element of ["A", "B", "C\n", "D", "E", "F"]
    w3 = each element of $load
    while {
      w5 = T1 {"Battery"="A", "Ramp"=5.313211, "Trend"="↗️", "Load"=10.912019, "Status"="🐗"}
      Is Greater(x=w1, y=4.5) -> w6
      Select(s=w6, t="↗️", f="↘️") -> w7
      Is Greater(x=w3, y=12) -> w8
      Select(s=w8, t="⚠️", f="👌") -> w9
      Property Node(instance in=w5, "Battery"=w2, "Ramp"=w1, "Trend"=w7, "Load"=w3, "Status"=w9) -> (instance out=w10)
      stop if TRUE
    }
    append w10 to w4
  }
  $Output <- w4
  $"Error Out" <- $"Error In"
