vi "Initialize.gvi"   [LabVIEW NXG 2.1.0]
inputs:
  "server url": string
  "username": string
  "password": string
  "error in": error
  "AuthPicker": "AuthPicker.gtype" = "User Name + Password"
  "api key": string
  "tag paths": string[] = ["Skyline.Examples.DataServices.bool", "Skyline.Examples.DataServices.numeric", "Skyline.Examples.DataServices.string", "Skyline.Examples.Oven.Inside.Temp", "Skyline.Examples.Oven.Outside.Temp"]
outputs:
  "error out": error
  "SystemLink Connection": T1
types:
  "AuthPicker.gtype" = enum{"User Name + Password", "API Key"}
  "DataType.gtype" = enum{"Double", "Integer", "String"}
  "Tag.gtype" = cluster{"Path": string, "Datatype": "DataType.gtype", "Configuration": "Configuration.gtype"}
  "Message Session.gtype" = cluster{"Configuration": "Configuration.gtype", "token": string}
  T1 = cluster{"Tags": "Tag.gtype"[], "Message Topic": string, "Message Configuration": "Message Session.gtype"}
uses:
  NI::Skyline::Configuration::Open Configuration.gvi
  NI::Skyline::Configuration::Open Configuration API Key.gvi
  NI::Skyline::TagHTTP::Open Tag.gvi
  NI::Skyline::MessageHTTP::Open.gvi
  NI::Skyline::MessageHTTP::Subscribe.gvi
diagram:
  case ($AuthPicker) {
    frame "User Name + Password", Default {
      call "Open Configuration.gvi"(server url=$"server url", username=$username, password=$password, error in=$"error in") -> (configuration=w1, error out=w2)
    }
    frame "API Key" {
      call "Open Configuration API Key.gvi"(server url=$"server url", api key=$"api key", error in=$"error in") -> (configuration=w1, error out=w2)
    }
  }
  for {
    w3 = each element of $"tag paths"
    call "Open Tag.gvi"(path=w3, data type="Double", error in=w2, configuration=w1) -> (tag out=w5, error out=w6)
    append w5 to w4
    stop if w6
  }
  w7 = "customizingwebvis.commands"  # topic
  call "Open.gvi"(error in=w6, configuration=w1) -> (message session out=w8, error out=w9)
  call "Subscribe.gvi"(message session=w8, topic=w7, error in=w9) -> (message session out=w10, error out=w11)
  Property Node(instance in=T1 {all zero or empty}, "Tags"=w4, "Message Topic"=w7, "Message Configuration"=w10) -> (instance out=w12)
  $"SystemLink Connection" <- w12
  $"error out" <- w11
