vi "Publish Message.gvi"   [LabVIEW NXG 2.1.0]
inputs:
  "SystemLink Connection": T1
  "message": string
  "error": error
outputs:
  "SystemLink Connection out": T1
  "error out": error
types:
  "DataType.gtype" = enum{"Double", "Integer", "String"}
  "Tag.gtype" = cluster{"Path": string, "Datatype": "DataType.gtype", "Configuration": "Configuration.gtype"}
  "Message Session.gtype" = cluster{"Configuration": "Configuration.gtype", "token": string}
  T1 = cluster{"Tags": "Tag.gtype"[], "Message Topic": string, "Message Configuration": "Message Session.gtype"}
uses:
  NI::Skyline::MessageHTTP::Publish.gvi
diagram:
  case ($error) {
    frame Error, Default {
      w1 = $"SystemLink Connection"
      w2 = $error
    }
    frame No Error {
      Property Node(instance in=$"SystemLink Connection") -> ("Message Configuration"=w3, "Message Topic"=w4, instance out=w1)
      call "Publish.gvi"(message session=w3, topic=w4, message=$message) -> (error out=w2)
    }
  }
  $"SystemLink Connection out" <- w1
  $"error out" <- w2
