vi "Read Example Tags.gvi"   [LabVIEW NXG 2.1.0]
inputs:
  "error in": error
  "SystemLink Connection": T1
outputs:
  "error out": error
  "ramp": f64[]
  "load": f64[]
  "SystemLink Connection out": T1
types:
  "DataType.gtype" = enum{"Double", "Integer", "String"}
  "Tag.gtype" = cluster{"Path": string, "Datatype": "DataType.gtype", "Configuration": "Configuration.gtype"}
  "Message Session.gtype" = cluster{"Configuration": "Configuration.gtype", "token": string}
  T1 = cluster{"Tags": "Tag.gtype"[], "Message Topic": string, "Message Configuration": "Message Session.gtype"}
uses:
  NI::Skyline::TagHTTP::Query Tags.gvi
  NI::Skyline::TagHTTP::Multi Read.gvi
diagram:
  $"SystemLink Connection out" <- $"SystemLink Connection"
  Property Node(instance in=$"SystemLink Connection") -> ("Tags"=w1)
  case ($"error in") {
    frame Error, Default {
      w2 = $"error in"
      w3 = f64[] []
      w4 = f64[] []
    }
    frame No Error {
      Array Index(array=w1) -> (out0[_]=w5)
      Property Node(instance in=w5) -> ("Configuration"=w6)
      call "Query Tags.gvi"(paths=["customizingwebvis.battery.load.*"], error in=$"error in", configuration=w6) -> (tags=w7, error out=w8)
      call "Multi Read.gvi"(tags in=w7, error in=w8) -> (tags out=w9, tag clusters=w10, error out=w11)
      for {
        w12 = each element of w10
        disable {
          frame Disabled {
            Random Number() -> (number (0 to 1)=w13)
          }
          frame Enabled {
            Property Node(instance in=w12) -> ("Value"=w15)
            Scan From String(inputString=w15, errIn=w11) -> (errOut=w14, out0=w13)
          }
        }
        append w13 to w4
      }
      Array Size(array=w9) -> (size(s)=w16)
      call "Query Tags.gvi"(paths=["customizingwebvis.battery.ramp.*"], error in=$"error in", configuration=w6) -> (tags=w17, error out=w18)
      call "Multi Read.gvi"(tags in=w17, error in=w18) -> (tag clusters=w19, error out=w20)
      for (N = w16) {
        w21 = each element of w19
        disable {
          frame Disabled {
            Random Number() -> (number (0 to 1)=w22)
          }
          frame Enabled {
            Property Node(instance in=w21) -> ("Value"=w24)
            Scan From String(inputString=w24, errIn=w20) -> (errOut=w23, out0=w22)
          }
        }
        append w22 to w3
      }
      Merge Errors(w14, w23) -> (error out=w2)
    }
  }
  $"error out" <- w2
  $ramp <- w3
  $load <- w4
